# Dynamo graph test3.2.dyn (Dynamo 2.6.2.15705)

element_types = ElementTypes("FloorType")
categories = Categories("OST_Floors")
all_elements_of_category = ElementsOfCategory()  # unwired: Category
all_elements_of_type = ElementsOfType()  # unwired: element_type
sortByKey = List.SortByKey()  # unwired: list, keys
code_block = CodeBlock { "Default Thickness"; }
getParameterValueByName = Element.GetParameterValueByName()  # unwired: element, parameterName
join = String.Join()  # unwired: separator, string0
code_block_2 = CodeBlock { "\n"; }
watch = Watch()  # unwired: arg0
elementType = Element.ElementType()  # unwired: element
setDifference = List.SetDifference()  # unwired: list1, list2
name = Element.Name()  # unwired: element
length = String.Length()  # unwired: str
watch_2 = Watch(length)
